# Grasshopper definition Form-Finding.gh (Grasshopper 1.0.7)
# plug-ins: Bifocals, Kangaroo2 Components

python_read_json = GhPythonScript(file_name="input.json")  # -> Square_Size, Point_Region, Points_Count, Random_Pts_Seeds, UV, Min_Pt_Ht, Max_Pt_Ht, Random_Points_Ht, LengthFactor, Button
# ---------- python_read_json: Python ----------
import json
import os

if file_name:
    
    # Open JSON file
    gh_file_name = ghenv.Component.OnPingDocument().FilePath
    file_path = os.path.dirname(gh_file_name) + '/' + file_name
    file = open(file_path)
    
    # Load the data
    data = json.load(file)
    print(data)
    
    # Extract the parameters from the dictionary
    Square_Size = data['Square_Size']
    Point_Region = data['Point_Region']
    Points_Count = data['Points_Count']
    Random_Pts_Seeds = data['Random_Pts_Seeds']
    UV = data['UV']
    Min_Pt_Ht = data['Min_Pt_Ht']
    Max_Pt_Ht = data['Max_Pt_Ht']
    Random_Points_Ht = data['Random_Points_Ht']
    LengthFactor = data['LengthFactor']
    Button = data['Button']
# ---------- end python_read_json ----------
panel = Panel(python_read_json.Square_Size)

panel_2 = Panel(python_read_json.Points_Count)
panel_3 = Panel(python_read_json.Min_Pt_Ht)
panel_4 = Panel(python_read_json.Max_Pt_Ht)
panel_5 = Panel(python_read_json.LengthFactor)
panel_6 = Panel(python_read_json.Point_Region)
panel_7 = Panel(python_read_json.Random_Pts_Seeds)
panel_8 = Panel(python_read_json.UV)
panel_9 = Panel(python_read_json.Random_Points_Ht)
panel_10 = Panel(python_read_json.Button)
square_size = Slider(5, range=5..10)
lengthfactor = Slider(0.7, range=0..1)
point_region = Slider(2, range=1..4)
points_count = Slider(2, range=0..5)
random_pts_seeds = Slider(1, range=1..10)
uv = Slider(20, range=10..30)
max_pt_ht = Slider(12, range=5..20)
random_points_ht = Slider(10, range=5..20)
min_pt_ht = Slider(5, range=5..20)

panel_11 = Panel("input.json")  # disabled
python_read_json_2 = GhPythonScript(file_name=panel_11)  # -> Square_Size, Point_Region, Points_Count, Random_Pts_Seeds, UV, Min_Pt_Ht, Max_Pt_Ht, Random_Points_Ht, LengthFactor, Button; disabled; same code as python_read_json
panel_12 = Panel(python_read_json_2.Square_Size)  # disabled
panel_13 = Panel(python_read_json_2.Point_Region)  # disabled
panel_14 = Panel(python_read_json_2.Points_Count)  # disabled
panel_15 = Panel(python_read_json_2.UV)  # disabled
panel_16 = Panel(python_read_json_2.LengthFactor)  # disabled
panel_17 = Panel(python_read_json_2.Random_Pts_Seeds)  # disabled
panel_18 = Panel(python_read_json_2.Min_Pt_Ht)  # disabled
panel_19 = Panel(python_read_json_2.Max_Pt_Ht)  # disabled
panel_20 = Panel(python_read_json_2.Random_Points_Ht)  # disabled
panel_21 = Panel(python_read_json_2.Button)  # disabled

button = Button()
subtraction = Subtraction(A=panel, B=panel_6)

dom = ConstructDomain(DomainStart=subtraction, DomainEnd=expr("-x", subtraction))
dom_2 = ConstructDomain(DomainStart=subtraction, DomainEnd=expr("-x", subtraction))
rectangle = Rectangle(Plane=PlaneXY(0, 0, 0), XSize=dom_2, YSize=dom, Radius=0)  # -> Rectangle, Length

dom_3 = ConstructDomain(DomainStart=panel, DomainEnd=expr("-x", panel))
dom_4 = ConstructDomain(DomainStart=panel, DomainEnd=expr("-x", panel))
rectangle_2 = Rectangle(Plane=PlaneXY(0, 0, 0), XSize=dom_4, YSize=dom_3, Radius=0)  # -> Rectangle, Length

mesh_uv = MeshSurface(Surface=rectangle_2.Rectangle, UCount=panel_8, VCount=panel_8, Overhang=True, Equalize=False)

mc = MeshCorners(Mesh=mesh_uv, Angle=2.35619449)
anchor = Anchor(Point=mc, Strength=10000)

edgelengths = EdgeLengths(Mesh=mesh_uv, LengthFactor=lengthfactor, Strength=1)
show = Show(G=mesh_uv)

area = Area(Geometry=rectangle_2.Rectangle)  # -> Area, Centroid
python_write_json = GhPythonScript(file_name="output_data.json", volume=area.Area)
# ---------- python_write_json: Python ----------
import json
import os

if file_name:
    
    # Data to be written
    data = {"volume": volume}
    
    # Write to JSON file
    gh_file_name = ghenv.Component.OnPingDocument().FilePath
    file_path = os.path.dirname(gh_file_name) + '/' + file_name
    
    with open(file_path, 'w') as outfile:
        json.dump(data, outfile)
# ---------- end python_write_json ----------

pop2d = Populate2D(Region=rectangle.Rectangle, Count=panel_2, Seed=panel_7)
demesh = DeconstructMesh(Mesh=mesh_uv)  # -> Vertices, Faces, Colours, Normals
neg = Negative(Value=panel_3)
cps = ClosestPoints(Point=pop2d, Cloud=demesh.Vertices, Count=1)  # -> flatten(ClosestPoint), CPIndex, Distance
dom_5 = ConstructDomain(DomainStart=neg, DomainEnd=panel_4)

random = Random(Range=dom_5, Number=panel_2, Seed=panel_9)

Z = UnitZ(Factor=random)
move = Move(Geometry=cps.ClosestPoint, Motion=Z)  # -> Geometry, Transform
anchor_2 = Anchor(Point=cps.ClosestPoint, Target=move.Geometry, Strength=10000)

solver = Solver(GoalObjects=[anchor, anchor_2, show, edgelengths], Reset=panel_10, Threshold=1e-15, Tolerance=0.0001, On=Toggle(True))  # -> I, V, O
bang = ExplodeTree(Data=solver.O)  # -> Branch0, Branch1
geo = Geometry(bang.Branch0)

python_bake = GhPythonScript(geometry=geo)  # -> geometry
# ---------- python_bake: Python ----------
import rhinoscriptsyntax as rs
import scriptcontext
import Rhino

doc_object = rs.coercerhinoobject(geometry)
geometry = doc_object.Geometry
scriptcontext.doc = Rhino.RhinoDoc.ActiveDoc

# Clear all existing Rhino objects
scriptcontext.doc.Objects.Clear()

# Add the new geometry as an object
scriptcontext.doc.Objects.Add(geometry)
scriptcontext.doc = ghdoc
# ---------- end python_bake ----------
python_export_obj = GhPythonScript(file_name="geometry.obj", geometry=python_bake)
# ---------- python_export_obj: Python ----------
import os
import Rhino

if file_name:
    
    # Write to OBJ file
    gh_file_name = ghenv.Component.OnPingDocument().FilePath
    file_path = os.path.dirname(gh_file_name) + '/' + file_name
    
    write_options = Rhino.FileIO.FileWriteOptions()
    write_options.WriteSelectedObjectsOnly = False
    
    obj_options = Rhino.FileIO.FileObjWriteOptions(write_options)
    obj_options.UseSimpleDialog = True
    obj_options.ExportMaterialDefinitions = False
    
    rc = Rhino.FileIO.FileObj.Write(file_path, Rhino.RhinoDoc.ActiveDoc, obj_options)
    if rc == Rhino.PlugIns.WriteFileResult.Success:
        print "Success, file saved:", file_path
    else:
        print "Error saving file:", file_path
# ---------- end python_export_obj ----------
